# Grasshopper definition urban_planing_parametric_model.gh (Grasshopper 1.0.7)

genes = GenePool(Decimals=0, Maximum=1, Minimum=0, Value=[0, 0, 0, 1, 0, 0.5])
genes_2 = GenePool(Decimals=2, Maximum=0.8, Minimum=0.2, Value=[0.2, 0.24, 0.2, 0.2, 0.2, 0.8, 0.5, 0.5])
genes_3 = GenePool(Decimals=0, Maximum=1, Minimum=0, Value=[1, 0, 1, 0, 1, 0, 0])
panel = Panel("C:\GitLab\buildingstoplots\src")
crv = Curve(<curve referenced from the Rhino model>)
python = GhPythonScript(
    src=panel,
    iCurv=crv,
    iN=Slider(10, range=2..10),
    iParams=genes_3,
    iDirections=genes_2,
    iSplits=genes,
    iAv="10000",
    iCentralSquare=Toggle(False))  # -> oPlots, o_diff, o_av_diff, oPoints, oStartPoint, oSquare; inputs iCurv: Curve, iN: Int32, iParams: list, iDirections: list, iSplits: list of Int32, iAv: Int32
# ---------- python: Python ----------
import ghpythonlib.components as ghcomp
import rhinoscriptsyntax as rs
import ghpythonlib.treehelpers as tree
import Rhino.Geometry as rg
import sys


if src not in sys.path:
    sys.path.append(src)

if 'load' in locals() and load:
    plot_subdivision = reload(plot_subdivision)
    
import plot_subdivision as ps

if iN <= 1:
    c = iCurv
    o_diff = 1
    o_av_diff = 1
else:
    plot_subdivision = ps.Plot(iCurv, iN, iParams, iDirections, iSplits)
    c = plot_subdivision.subdivide_plot()
    dif_tupple = ps.average_area_diff(c, iAv)
    o_diff = dif_tupple[0]
    o_av_diff = dif_tupple[1]
    av_area = dif_tupple[2]

centroid_plot = ghcomp.Area(iCurv)[1]
centroid_subplots = [ghcomp.Area(polycurve)[1] for polycurve in c]

if iCentralSquare == True:
    centroid_square = centroid_subplots[0]
    square = c[0]
    index = 0
    for i, (cen, polycurve) in enumerate(zip(centroid_subplots, c)):
        distance = centroid_plot.DistanceTo(cen)
        if centroid_plot.DistanceTo(cen) < centroid_plot.DistanceTo(centroid_square):
            centroid_square = cen
            square = polycurve
            index = i
    centroid_subplots.pop(index)
    c.pop(index)
    square_surface = ghcomp.BoundarySurfaces(square)

else:
    centroid_subplots = [ghcomp.Area(polycurve)[1] for polycurve in c if ghcomp.Area(polycurve)[0] > av_area * 0.35]
    square_surface = []

oPlots = c
oPoints = centroid_subplots
oStartPoint = iCurv.PointAt(0)
oSquare = square_surface
# ---------- end python ----------
sortpath = CSharpScript(P=python.oStartPoint, S=python.oPoints)  # -> A; inputs P: Point3d, S: list of Point3d; disabled
# ---------- sortpath: C# ----------
    List<Point3d> ptsSorted = new List<Point3d>();
    int count = S.Count;

    for(int i = 0; i < count; i++)
    {
      Point3dList ptsToSort = new Point3dList(S);
      int closestIndex = ptsToSort.ClosestIndex(P);

      ptsSorted.Add(S[closestIndex]);
      S.RemoveAt(closestIndex);
      P = ptsToSort[closestIndex];
    }

    A = ptsSorted;
# ---------- end sortpath ----------
block_line_length_factor = Slider(0.97, range=0.8..0.99)
block_min_dis_factor = Slider(1, range=1..2)
block_length_factor = Slider(1.2, range=1..2)
intcrv = Interpolate(Vertices=sortpath, Degree=3, Periodic=False, KnotStyle=1)  # -> Curve, Length, Domain; disabled
building_width = Slider(12, range=8..20)
building_high = Slider(17, range=8..20)
mesh_color = BooleanToggle(True)
ghpython_script = GhPythonScript(
    src=panel,
    iPlots=python.oPlots,
    building_width=building_width,
    building_high=building_high,
    block_min_dis_factor=block_min_dis_factor,
    block_line_length_factor=block_line_length_factor,
    block_length_factor=block_length_factor,
    color=mesh_color)  # -> out, flatten(output); inputs iPlots: list
# ---------- ghpython_script: Python ----------
import sys
import ghpythonlib.treehelpers as th

if src not in sys.path:
    sys.path.append(src)
    
import utility
import buildings

load = True
if 'load' in locals() and load:
    utility = reload(utility)
    buildings = reload(buildings)

from buildings import *
from utility import *
    
building_plots = Buildings(iPlots, building_width, building_high, block_min_dis_factor, block_line_length_factor, block_length_factor, color)
brep_buildings = building_plots.plot_houses()
brep_plots = building_plots.plots()

print brep_plots
output = th.list_to_tree([brep_buildings, brep_plots])

print output
# ---------- end ghpython_script ----------
panel_2 = Panel(ghpython_script.output)
